# Grasshopper definition 5-1-1_Frame.gh (Grasshopper 1.0.8)
# plug-ins: Pufferfish

# ----
# Frame
hole_diameter = Slider(1.98, range=0..2)
connector = BooleanToggle(True)
edgehole = BooleanToggle(True)
notch_direction = ValueList({"X": 0, "X_inv": 1, "Y": 2, "Y_inv": 3}, selected="X")
hole_offset = Slider(0, range=-1..1)
frame_height = Slider(5, range=0..5)
notch_number = Slider(10, range=0..30)
entrance = BooleanToggle(True)
frame_width = Slider(5, range=0..5)
connector_length = Slider(4, range=0..10)
entrance_width = Slider(1.5, range=0..2)
filament_diameter = Slider(1.75, range=0..10)

# ---- group: Input one curve
crv = Curve(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)

# ----
panel = Panel("""0
-1""")

# ---- group: curve
crv_2 = Curve(reparameterize(crv))

# ----
divide = DivideCurve(Curve=crv_2, Count=notch_number, Kinks=False)  # -> Points, Tangents, Parameters
cull_i = CullIndex(List=divide.Points, Indices=panel, Wrap=True)
pt = Point(cull_i)

division = Division(A=filament_diameter, B=2)
pframe = PerpFrame(Curve=crv_2, Parameter="0")
pframe_2 = PerpFrame(Curve=crv_2, Parameter="1")
cir = Circle(Plane=pframe_2, Radius=division)
cir_2 = Circle(Plane=pframe, Radius=division)
facen = FaceNormals(Mesh=pframe)  # -> Centers, Normals
facen_2 = FaceNormals(Mesh=pframe_2)  # -> Centers, Normals
amp = Amplitude(Vector=facen.Normals, Amplitude=connector_length)
amp_2 = Amplitude(Vector=facen_2.Normals, Amplitude=connector_length)
neg = Negative(Value=amp)
extr = Extrude(Base=cir, Direction=amp_2)
extr_2 = Extrude(Base=cir_2, Direction=neg)
cap = CapHoles(Brep=extr)
cap_2 = CapHoles(Brep=extr_2)
brep = Brep(cap)
brep_2 = Brep(cap_2)
sunion = SolidUnion(Breps=[brep_2, brep])
filter = StreamFilter(Gate=connector, Stream1=sunion)

division_2 = Division(A=frame_height, B=2)
len = Length(Curve=crv_2)
subtraction = Subtraction(A=len, B=division_2)
merge = Merge(Data1=division_2, Data2=subtraction)
eval = EvaluateLength(Curve=crv_2, Length=merge, Normalized=False)  # -> Point, Tangent, Parameter
pframe_3 = PerpFrame(Curve=crv_2, Parameter=eval.Parameter)
addition = Addition(A=frame_height, B=1)
deplane = DeconstructPlane(Plane=pframe_3)  # -> Origin, XAxis, YAxis, ZAxis
neg_2 = Negative(Value=deplane.XAxis)
neg_3 = Negative(Value=deplane.YAxis)
line = LineSDL(Start=eval.Point, Direction=deplane.XAxis, Length=addition)
line_2 = LineSDL(Start=eval.Point, Direction=neg_2, Length=addition)
line_3 = LineSDL(Start=eval.Point, Direction=deplane.YAxis, Length=addition)
line_4 = LineSDL(Start=eval.Point, Direction=neg_3, Length=addition)
join = JoinCurves(Curves=[line, line_2], Preserve=False)
division_3 = Division(A=hole_diameter, B=2)
join_2 = JoinCurves(Curves=[line_3, line_4], Preserve=False)
pipe = Pipe(Curve=join, Radius=division_3, Caps=0)
pipe_2 = Pipe(Curve=join_2, Radius=division_3, Caps=0)
cap_3 = CapHoles(Brep=pipe)
cap_4 = CapHoles(Brep=pipe_2)
sunion_2 = SolidUnion(Breps=[cap_3, cap_4])  # -> flatten(Result)

preview = CustomPreview(Geometry=filter, Material=ColourSwatch(SwatchColor=RGB(202, 189, 54)))

crv_cp = CurveClosestPoint(Point=pt, Curve=crv_2)  # -> Point, Parameter, Distance
pframe_4 = PerpFrame(Curve=crv_2, Parameter=crv_cp.Parameter)
deplane_2 = DeconstructPlane(Plane=pframe_4)  # -> Origin, XAxis, YAxis, ZAxis
max = Maximum(A=frame_width, B=frame_height)
neg_4 = Negative(Value=max)
neg_5 = Negative(Value=frame_height)
dom = ConstructDomain(DomainStart=neg_4, DomainEnd=max)
amp_3 = Amplitude(Vector=deplane_2.XAxis, Amplitude=max)
neg_6 = Negative(Value=amp_3)
rectangle = Rectangle(Plane=pframe_4, XSize=dom, YSize=frame_height, Radius=0)  # -> Rectangle, Length
rectangle_2 = Rectangle(Plane=pframe_4, XSize=neg_5, YSize=dom, Radius=0)  # -> Rectangle, Length
rectangle_3 = Rectangle(Plane=pframe_4, XSize=frame_height, YSize=dom, Radius=0)  # -> Rectangle, Length
ln = Line(StartPoint=amp_3, EndPoint=neg_6)
division_4 = Division(A=hole_diameter, B=2)
move = Move(Geometry=ln, Motion=deplane_2.Origin)  # -> Geometry, Transform
division_5 = Division(A=entrance_width, B=2)
pipe_3 = Pipe(Curve=move.Geometry, Radius=division_4, Caps=0)
cap_5 = CapHoles(Brep=pipe_3)
equals = Equality(FirstNumber=notch_direction, SecondNumber="0")  # -> Equality, Inequality
equals_2 = Equality(FirstNumber=notch_direction, SecondNumber="1")  # -> Equality, Inequality
or = GateOr(A=equals.Equality, B=equals_2.Equality)

amp_4 = Amplitude(Vector=deplane_2.YAxis, Amplitude=max)
neg_7 = Negative(Value=amp_4)
rectangle_4 = Rectangle(Plane=pframe_4, XSize=dom, YSize=neg_5, Radius=0)  # -> Rectangle, Length
ln_2 = Line(StartPoint=amp_4, EndPoint=neg_7)
move_2 = Move(Geometry=ln_2, Motion=deplane_2.Origin)  # -> Geometry, Transform
filter_2 = StreamFilter(Gate=notch_direction, Stream0=amp_3, Stream1=neg_6, Stream2=amp_4, Stream3=neg_7)
amp_5 = Amplitude(Vector=filter_2, Amplitude=hole_offset)  # -> graft(Vector)

len_2 = Length(Curve=crv_2)
division_6 = Division(A=frame_width, B=2)
division_7 = Division(A=frame_height, B=2)
division_8 = Division(A=len_2, B=2)
neg_8 = Negative(Value=division_6)
neg_9 = Negative(Value=division_7)
dom_2 = ConstructDomain(DomainStart=neg_8, DomainEnd=division_6)
dom_3 = ConstructDomain(DomainStart=neg_9, DomainEnd=division_7)
pframes = PerpFrames(Curve=crv_2, Count=division_8, Align=True)  # -> Frames, Parameters
rectangle_5 = Rectangle(Plane=pframes.Frames, XSize=dom_2, YSize=dom_3, Radius=0)  # -> Rectangle, Length
loft = Loft(
    Curves=rectangle_5.Rectangle,
    Options={Adjust=False, Closed=False, LoftEnds=0, LoftSimp=0, LoftType=0, Rebuild=10, Refit=0.01})
cap_6 = CapHoles(Brep=loft)
brep_3 = Brep(cap_6)

filter_3 = StreamFilter(
    Gate=notch_direction,
    Stream0=rectangle_3.Rectangle,
    Stream1=rectangle_2.Rectangle,
    Stream2=rectangle.Rectangle,
    Stream3=rectangle_4.Rectangle)
offsrf = OffsetSurface(Surface=filter_3, Distance=division_5, BothSides=True, CreateSolid=True)
pipe_4 = Pipe(Curve=move_2.Geometry, Radius=division_4, Caps=0)
cap_7 = CapHoles(Brep=pipe_4)
brep_4 = Brep(offsrf)
filter_4 = StreamFilter(Gate=or, Stream0=cap_5, Stream1=cap_7)

move_3 = Move(Geometry=brep_4, Motion=amp_5)  # -> Geometry, Transform
move_4 = Move(Geometry=filter_4, Motion=amp_5)  # -> Geometry, Transform
filter_5 = StreamFilter(Gate=entrance, Stream1=move_3.Geometry)

sunion_3 = SolidUnion(Breps=[move_4.Geometry, filter_5])
brep_5 = Brep(flatten(sunion_3))

sdiff = SolidDifference(BrepsA=brep_3, BrepsB=brep_5)
sdiff_2 = SolidDifference(BrepsA=sdiff, BrepsB=sunion_2)
filter_6 = StreamFilter(Gate=edgehole, Stream0=sdiff, Stream1=sdiff_2)

# ---- group: Result
brep_6 = Brep(filter_6)

# ----
preview_2 = CustomPreview(Geometry=filter_6, Material=ColourSwatch(SwatchColor=RGB(80, 95, 255)))
preview_3 = CustomPreview(Geometry=move_4.Geometry, Material=ColourSwatch(SwatchColor=RGBA(255, 255, 255, 122)))
