# Grasshopper definition 5-1-2_Connector.gh (Grasshopper 1.0.8)
# plug-ins: MeshEdit Components, LunchBox

# ----
# Polyhedron connector
filament_diameter = Slider(1.75, range=0..2)
list = ValueList({"Tetrahedron": 0, "Cube": 1, "Octahedron": 2, "Dodecahedron": 3, "Icosahedron": 4}, selected="Dodecahedron")
number_slider = Slider(10, range=0..20)

# ----
# Polygon connector
hole_depth = Slider(5, range=0..10)
radius = Slider(10, range=0..20)
height = Slider(4, range=0..10)

# ----
# Convex hull connector
# Set multiple intersecting curves or one self-intersecting curve
size_2 = Slider(6, range=2..10)
size_1 = Slider(4, range=0..10)

# ---- group: Input
crv = Curve([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])

# ----
crv_2 = Curve(reparameterize(simplify(crv)))
platocube = PlatonicCube(Plane=PlaneXY(0, 0, 0), Radius=number_slider, Truncation=0)
platododec = PlatonicDodecahedron(Plane=PlaneXY(0, 0, 0), Radius=number_slider)
platotetra = PlatonicTetrahedron(Plane=PlaneXY(0, 0, 0), Radius=number_slider, Truncation=0)
platoocta = PlatonicOctahedron(Plane=PlaneXY(0, 0, 0), Radius=number_slider, Truncation=0)
platoicosa = PlatonicIcosahedron(Plane=PlaneXY(0, 0, 0), Radius=number_slider, Truncation=0.38198)
division = Division(A=filament_diameter, B="2")
xy = XYPlane(Origin=Point(0, 0, 0))
multiplication = Multiplication(A=radius, B=2)
explode = Explode(Curve=crv_2, Recursive=False)  # -> reparameterize(flatten(Segments)), Vertices
join = JoinCurves(Curves=crv_2, Preserve=False)
polygon = Polygon(Plane=xy, Radius=radius, Segments=Slider(8, range=0..14), FilletRadius=0)  # -> reparameterize(Polygon), Length
neg = Negative(Value=multiplication)
division_2 = Division(A=size_2, B=2)
filter = StreamFilter(Gate=list, Stream0=platotetra, Stream1=platocube, Stream2=platoocta, Stream3=platododec, Stream4=platoicosa)
mcx = MultipleCurves(Curves=explode.Segments)  # -> Points, IndexA, IndexB, ParamA, ParamB
dom = ConstructDomain(DomainStart=neg, DomainEnd=multiplication)
rotate = Rotate(Geometry=polygon.Polygon, Angle=1.570796327, Plane=xy)  # -> Geometry, Transform
disc = Discontinuity(Curve=rotate.Geometry, Level=1)  # -> Points, Parameters
neg_2 = Negative(Value=division_2)
shatter = Shatter(Curve=reparameterize(rotate.Geometry), Parameters=disc.Parameters)
debrep = DeconstructBrep(Brep=filter)  # -> Faces, Edges, Vertices
rectangle = Rectangle(Plane=xy, XSize=dom, YSize=dom, Radius=0)  # -> Rectangle, Length
item = ListItem(List=explode.Segments, Index=mcx.IndexB, Wrap=True)
item_2 = ListItem(List=explode.Segments, Index=mcx.IndexA, Wrap=True)
dom_2 = ConstructDomain(DomainStart=neg_2, DomainEnd=division_2)
Z = UnitZ(Factor=height)
Z_2 = UnitZ(Factor=height)
frame = CurveFrame(Curve=reparameterize(shatter), Parameter=Slider(0.5, range=0..1))
area = Area(Geometry=debrep.Faces)  # -> Area, Centroid
join_2 = BrepJoin(Breps=debrep.Faces)  # -> Breps, Closed
pt = ConstructPoint(XCoordinate=0, YCoordinate=0, ZCoordinate=0)
division_3 = Division(A=height, B=2)
extr = Extrude(Base=rotate.Geometry, Direction=Z)
extr_2 = Extrude(Base=rectangle.Rectangle, Direction=Z_2)
pframe = PerpFrame(Curve=item, Parameter=simplify(mcx.ParamB))
pframe_2 = PerpFrame(Curve=item_2, Parameter=simplify(mcx.ParamA))
ln = Line(StartPoint=area.Centroid, EndPoint=pt)
pt_2 = ConstructPoint(XCoordinate=0, YCoordinate=0, ZCoordinate=0)
neg_3 = Negative(Value=division_3)
cap = CapHoles(Brep=extr)
cap_2 = CapHoles(Brep=extr_2)
deplane = DeconstructPlane(Plane=pframe)  # -> Origin, XAxis, YAxis, ZAxis
rectangle_2 = Rectangle(Plane=pframe, XSize=dom_2, YSize=dom_2, Radius=0)  # -> Rectangle, Length
deplane_2 = DeconstructPlane(Plane=pframe_2)  # -> Origin, XAxis, YAxis, ZAxis
ext = ExtendCurve(Curve=ln, Type=0, Start=1, End=0)
rectangle_3 = Rectangle(Plane=pframe_2, XSize=dom_2, YSize=dom_2, Radius=0)  # -> Rectangle, Length
Z_3 = UnitZ(Factor=neg_3)
neg_4 = Negative(Value=size_1)
pipe = Pipe(Curve=ext, Radius=division, Caps=1)  # -> flatten(Pipe)
move = Move(Geometry=cap_2, Motion=Z_3)  # -> Geometry, Transform
move_2 = Move(Geometry=cap, Motion=Z_3)  # -> Geometry, Transform
merge = Merge(Data1=size_1, Data2=neg_4)
boolean_difference_hispeed = BooleanDifferenceHiSpeed(x=join_2.Breps, y=pipe)

# ---- group: Result
brep = Brep(boolean_difference_hispeed)

# ----
sdiff = SolidDifference(BrepsA=move.Geometry, BrepsB=move_2.Geometry)
amp = Amplitude(Vector=deplane_2.ZAxis, Amplitude=graft(merge))
amp_2 = Amplitude(Vector=deplane.ZAxis, Amplitude=graft(merge))
vec2pt = Vector2Pt(PointA=frame, PointB=pt_2, Unitize=False)  # -> Vector, Length
extr_3 = Extrude(Base=rectangle_3.Rectangle, Direction=amp)  # -> simplify(flatten(Extrusion))
line = LineSDL(Start=frame, Direction=vec2pt.Vector, Length=hole_depth)
extr_4 = Extrude(Base=rectangle_2.Rectangle, Direction=amp_2)  # -> simplify(flatten(Extrusion))
cap_3 = CapHoles(Brep=extr_4)
cap_4 = CapHoles(Brep=extr_3)
pipe_2 = Pipe(Curve=line, Radius=division, Caps=1)  # -> flatten(Pipe)
sunion = SolidUnion(Breps=cap_4)
sunion_2 = SolidUnion(Breps=cap_3)
crv_3 = Curve(reparameterize(simplify(join)))
merge_2 = Merge(Data1=graft(sunion), Data2=graft(sunion_2))
num = Number(division)
boolean_difference_hispeed_2 = BooleanDifferenceHiSpeed(x=move_2.Geometry, y=pipe_2)

# ---- group: Result
brep_2 = Brep(boolean_difference_hispeed_2)

# ----
pipe_3 = Pipe(Curve=crv_3, Radius=num, Caps=0)
sunion_3 = SolidUnion(Breps=merge_2)  # -> flatten(Result)
debrep_2 = DeconstructBrep(Brep=sunion_3)  # -> Faces, Edges, Vertices
convexhull = _3DConvexHull(Points=debrep_2.Vertices)
preview = CustomPreview(
    Geometry=boolean_difference_hispeed,
    Material={diffuse=RGB(221, 160, 221), emission=RGB(66, 48, 66), shine=0.5, specular=RGB(255, 255, 255), transparency=0})
preview_2 = CustomPreview(
    Geometry=boolean_difference_hispeed_2,
    Material={diffuse=RGB(221, 160, 221), emission=RGB(66, 48, 66), shine=0.5, specular=RGB(255, 255, 255), transparency=0})
demesh = DeconstructMesh(Mesh=simplify(convexhull))  # -> simplify(Vertices), simplify(Faces), Colours, Normals
group = Group(Objects=demesh.Vertices)  # -> flatten(Group)
lng = ListLength(List=demesh.Faces)
deface = DeconstructFace(Face=demesh.Faces)  # -> CornerA, CornerB, CornerC, CornerD
dup = DuplicateData(Data=graft(group), Number=lng, Order=False)  # -> simplify(Data)
merge_3 = Merge(Data1=graft(deface.CornerA), Data2=graft(deface.CornerB), Data3=graft(deface.CornerC))  # -> simplify(Result)
ungroup = Ungroup(Group=dup)  # -> simplify(Objects)
item_3 = ListItem(List=ungroup, Index=merge_3, Wrap=True)
pline = PolyLine(Vertices=item_3, Closed=True)
boundary = BoundarySurfaces(Edges=pline)
sunion_4 = SolidUnion(Breps=flatten(pipe_3))
join_3 = BrepJoin(Breps=flatten(boundary))  # -> Breps, Closed
boolean_difference_hispeed_3 = BooleanDifferenceHiSpeed(x=join_3.Breps, y=sunion_4)

# ---- group: Result
brep_3 = Brep(boolean_difference_hispeed_3)

# ----
preview_3 = CustomPreview(Geometry=pipe_3, Material=ColourSwatch(SwatchColor=RGBA(255, 255, 255, 123)))
preview_4 = CustomPreview(Geometry=boolean_difference_hispeed_3, Material=ColourSwatch(SwatchColor=RGB(202, 189, 54)))

# ==== cluster BooleanDifferenceHiSpeed
x = ClusterInput()
y = ClusterInput()
boolean_difference = GhPythonScript(x=x, y=flatten(y))  # -> out, a; inputs y: list
# ---------- boolean_difference: Python ----------
import rhinoscriptsyntax as rs
a=rs.BooleanDifference(x,y)
# ---------- end boolean_difference ----------
output = ClusterOutput(boolean_difference.a)
