# Grasshopper definition 5-1-3_ShapingProxy.gh (Grasshopper 1.0.8)

# ----
# Shaping tool
rail_width = Slider(2, range=0..10)
width = Slider(4, range=0..10)
shaping_rail_rotation = Slider(181, range=0..360)

# ----
# Example curve
number_slider = Slider(50, range=0..100)
Z = UnitZ(Factor=number_slider)
series = Series(Start=Slider(10, range=0..10), Step=0, Count=Slider(100, range=0..100))
sph = Sphere(Base=PlaneXY(0, 0, 0), Radius=number_slider)
move = Move(Geometry=sph, Motion=Z)  # -> Geometry, Transform
contour = ContourEx(Shape=move.Geometry, Plane=PlaneXY(0, 0, 0), Distances=series)  # -> flatten(Contours)
lng = ListLength(List=contour)
pt = ConstructPoint(XCoordinate=0, YCoordinate=1, ZCoordinate=0)
pt_2 = ConstructPoint(XCoordinate=0, YCoordinate=0, ZCoordinate=0)
number_slider_2 = Slider(24, range=0..30)
subtraction = Subtraction(A=lng, B=1)
evalsrf = EvaluateSurface(Surface=reparameterize(move.Geometry), Point=pt)  # -> Point, Normal, UDirection, VDirection, Frame
evalsrf_2 = EvaluateSurface(Surface=reparameterize(move.Geometry), Point=pt_2)  # -> Point, Normal, UDirection, VDirection, Frame
dom = ConstructDomain(DomainStart=0, DomainEnd=subtraction)
range = Range(Domain=dom, Steps=subtraction)  # -> graft(Range)
divide = DivideCurve(Curve=contour, Count=number_slider_2, Kinks=False)  # -> simplify(Points), Tangents, Parameters
shift = ShiftList(List=divide.Points, Shift=simplify(range), Wrap=True)  # -> simplify(List)
dup = DuplicateData(Data=evalsrf_2.Point, Number=number_slider_2, Order=True)
dup_2 = DuplicateData(Data=evalsrf.Point, Number=number_slider_2, Order=True)
flip = FlipMatrix(Data=shift)
merge = Merge(Data1=simplify(graft(dup)), Data2=flip, Data3=simplify(graft(dup_2)))
intcrv = Interpolate(Vertices=merge, Degree=3, Periodic=False, KnotStyle=1)  # -> flatten(Curve), Length, Domain
dispatch = Dispatch(List=intcrv.Curve, DispatchPattern=[True, False])  # -> ListA, ListB
crv = Curve(dispatch.ListA)
item = ListItem(List=crv, Index=0, Wrap=True)
pipe = Pipe(Curve=crv, Radius=1, Caps=0)
preview = CustomPreview(Geometry=move.Geometry, Material=ColourSwatch(SwatchColor=RGBA(255, 175, 255, 131)))
preview_2 = CustomPreview(Geometry=pipe, Material=ColourSwatch(SwatchColor=RGB(255, 255, 255)))

# ---- group: Example curve
crv_2 = Curve(item)

# ---- group: Input curve
crv_3 = Curve(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)

# ----
stopper_num = Slider(10, range=0..10)
# Change the connection
crv_4 = Curve(reparameterize(crv_2))
len = Length(Curve=crv_4)
division = Division(A=len, B=2)
rad = Radians(Degrees=shaping_rail_rotation)
number_slider_3 = Slider(2.5, range=0..10)
pframes = PerpFrames(Curve=reparameterize(crv_4), Count=stopper_num, Align=True)  # -> Frames, Parameters
pframes_2 = PerpFrames(Curve=crv_4, Count=division, Align=True)  # -> Frames, Parameters
division_2 = Division(A=rail_width, B=2)
rotate = Rotate(Geometry=pframes_2.Frames, Angle=rad, Plane=pframes_2.Frames)  # -> Geometry, Transform
rotate_2 = Rotate(Geometry=pframes.Frames, Angle=rad, Plane=pframes.Frames)  # -> Geometry, Transform
neg = Negative(Value=division_2)
neg_2 = Negative(Value=width)
neg_3 = Negative(Value=number_slider_3)
dom_2 = ConstructDomain(DomainStart=Slider(-1, range=-1..100), DomainEnd=Slider(3, range=0..10))
dom_3 = ConstructDomain(DomainStart=neg, DomainEnd=division_2)
dom_4 = ConstructDomain(DomainStart=neg_2, DomainEnd=width)
dom_5 = ConstructDomain(DomainStart=neg_3, DomainEnd=number_slider_3)
division_3 = Division(A=1, B=len)
rectangle = Rectangle(Plane=rotate.Geometry, XSize=dom_2, YSize=dom_3, Radius=0)  # -> Rectangle, Length
rectangle_2 = Rectangle(Plane=rotate.Geometry, XSize=dom_5, YSize=dom_4, Radius=0)  # -> Rectangle, Length
loft = Loft(
    Curves=rectangle.Rectangle,
    Options={Adjust=False, Closed=False, LoftEnds=0, LoftSimp=0, LoftType=0, Rebuild=10, Refit=0.01})
multiplication = Multiplication(A=division_3, B=Slider(3, range=0..10))
loft_2 = Loft(
    Curves=rectangle_2.Rectangle,
    Options={Adjust=False, Closed=False, LoftEnds=0, LoftSimp=0, LoftType=0, Rebuild=10, Refit=0.01})
cull_i = CullIndex(List=pframes.Parameters, Indices="-1", Wrap=True)
item_2 = ListItem(List=pframes.Parameters, Index="-1", Wrap=True)
addition = Addition(A=cull_i, B=multiplication)
cap = CapHoles(Brep=loft)
number_slider_4 = Slider(2.5, range=0..10)
cap_2 = CapHoles(Brep=loft_2)
number_slider_5 = Slider(4, range=0..10)
subtraction_2 = Subtraction(A=item_2, B=multiplication)
merge_2 = Merge(Data1=simplify(flatten(addition)), Data2=simplify(flatten(subtraction_2)))
neg_4 = Negative(Value=number_slider_4)
neg_5 = Negative(Value=number_slider_5)
pframe = PerpFrame(Curve=crv_4, Parameter=merge_2)
dom_6 = ConstructDomain(DomainStart=Slider(1, range=-1..100), DomainEnd=number_slider_4)
dom_7 = ConstructDomain(DomainStart=neg_5, DomainEnd=number_slider_5)
rotate_3 = Rotate(Geometry=pframe, Angle=rad, Plane=pframe)  # -> Geometry, Transform
rectangle_3 = Rectangle(Plane=rotate_2.Geometry, XSize=dom_6, YSize=dom_7, Radius=0)  # -> Rectangle, Length
rectangle_4 = Rectangle(Plane=rotate_3.Geometry, XSize=dom_6, YSize=dom_7, Radius=0)  # -> Rectangle, Length
sdiff = SolidDifference(BrepsA=cap_2, BrepsB=cap)  # -> flatten(Result)
merge_3 = Merge(Data1=simplify(graft(rectangle_4.Rectangle)), Data2=simplify(graft(rectangle_3.Rectangle)))
loft_3 = Loft(Curves=merge_3, Options={Adjust=False, Closed=False, LoftEnds=0, LoftSimp=0, LoftType=0, Rebuild=10, Refit=0.01})
cap_3 = CapHoles(Brep=loft_3)  # -> flatten(Brep)
pipe_2 = Pipe(Curve=crv_4, Radius=1, Caps=0)
group = Group(Objects=[sdiff, cap_3])
ungroup = Ungroup(Group=group)
cap_4 = CapHoles(Brep=pipe_2)
sunion = SolidUnion(Breps=ungroup)

# ---- group: Result
brep = Brep(sunion)

# ----
preview_3 = CustomPreview(Geometry=group, Material=ColourSwatch(SwatchColor=RGB(80, 95, 255)))
preview_4 = CustomPreview(Geometry=cap_4, Material=ColourSwatch(SwatchColor=RGBA(255, 255, 255, 110)))
