# Grasshopper definition 5-2_FramentWiring.gh (Grasshopper 1.0.8)
# plug-ins: Pufferfish, Kangaroo2 Components

spiral = BooleanToggle(True)
frame_hole_radius = Slider(1.98, range=0..5)
notchdirection = BooleanToggle(False)
frame_thickness = Slider(2, range=0..2)
notch_entrance_width = Slider(1.5, range=0..10)

V = Slider(7, range=0..30)
frame_direction = ValueList({"U": 0, "V": 1}, selected="V")
U = Slider(4, range=0..30)

# ----
# Filament wiring
# Select one surface
srf = Surface(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)

range = Range(Domain=Domain(0, 1), Steps=Slider(50, range=-1..100))
bool = Boolean(spiral)
bool_2 = Boolean(notchdirection)
bool_3 = Boolean(bool)

# ---- group: V num
num = Number(V)

# ---- group: U num
num_2 = Number(U)

# ----
srfclsd = IsSurfaceClosed(Surface=srf)  # -> Closed, ClosedU, ClosedV
filter = StreamFilter(Gate=bool_3, Stream1=srf)
bool_4 = Boolean(bool_2)
srf_2 = Surface(filter)

# ---- group: Frame thickness
num_3 = Number(frame_thickness)

# ---- group: notch dir
bool_5 = Boolean(bool_4)

# ---- group: range
num_4 = Number(range)

# ---- group: U num
num_5 = Number(U)

# ---- group: Frame thickness
num_6 = Number(num_3)

# ---- group: V num
num_7 = Number(V)

# ----
filter_2 = StreamFilter(Gate=bool_3, Stream0=srf)

# ---- group: notch dir
bool_6 = Boolean(bool_4)

# ---- group: Frame thickness
num_8 = Number(frame_thickness)

# ---- group: range
num_9 = Number(range)

# ---- group: V num
num_10 = Number(V)

# ---- group: U num
num_11 = Number(U)

# ----
srf_3 = Surface(filter_2)

# ---- group: U close
bool_7 = Boolean(srfclsd.ClosedU)

# ---- group: V close
bool_8 = Boolean(srfclsd.ClosedV)

# ---- group: U close
bool_9 = Boolean(srfclsd.ClosedU)

# ---- group: V close
bool_10 = Boolean(srfclsd.ClosedV)

# ----
division = Division(A=notch_entrance_width, B=2)

subtraction = Subtraction(A=num_10, B=1)
subtraction_2 = Subtraction(A=num_11, B=1)
filter_3 = StreamFilter(Gate=bool_10, Stream0=subtraction, Stream1=num_7)
filter_4 = StreamFilter(Gate=bool_9, Stream0=subtraction_2, Stream1=num_5)
number_slider = Slider(0.03, range=0..0.1)
V_2 = Panel(filter_3)
range_2 = Range(Domain=Domain(0, 1), Steps=filter_3)
range_3 = Range(Domain=Domain(0, 1), Steps=filter_4)
U_2 = Panel(filter_4)
cull_i = CullIndex(List=range_2, Indices=-1, Wrap=True)
cull_i_2 = CullIndex(List=range_3, Indices=-1, Wrap=True)
addition = Addition(A=cull_i, B=number_slider)
num_12 = Number(num_9)
addition_2 = Addition(A=cull_i_2, B=number_slider)
filter_5 = StreamFilter(Gate=bool_10, Stream0=range_2, Stream1=addition)
filter_6 = StreamFilter(Gate=bool_9, Stream0=range_3, Stream1=addition_2)
pt = ConstructPoint(XCoordinate=num_12, YCoordinate=graft(filter_5), ZCoordinate=0)
pt_2 = ConstructPoint(XCoordinate=graft(filter_6), YCoordinate=num_12, ZCoordinate=0)
evalsrf = EvaluateSurface(Surface=reparameterize(srf_3), Point=pt)  # -> Point, Normal, UDirection, VDirection, Frame
evalsrf_2 = EvaluateSurface(Surface=reparameterize(srf_3), Point=pt_2)  # -> Point, Normal, UDirection, VDirection, Frame
amp = Amplitude(Vector=evalsrf.VDirection, Amplitude=num_8)
amp_2 = Amplitude(Vector=evalsrf_2.UDirection, Amplitude=num_8)
neg = Negative(Value=amp)
neg_2 = Negative(Value=amp_2)
toggle = BooleanToggle(False)
move = Move(Geometry=evalsrf.Point, Motion=amp)  # -> Geometry, Transform
move_2 = Move(Geometry=evalsrf.Point, Motion=neg)  # -> Geometry, Transform
move_3 = Move(Geometry=evalsrf_2.Point, Motion=neg_2)  # -> Geometry, Transform
move_4 = Move(Geometry=evalsrf_2.Point, Motion=amp_2)  # -> Geometry, Transform
intcrv = Interpolate(Vertices=move_4.Geometry, Degree=3, Periodic=toggle, KnotStyle=1)  # -> simplify(Curve), Length, Domain
intcrv_2 = Interpolate(Vertices=move_3.Geometry, Degree=3, Periodic=toggle, KnotStyle=1)  # -> simplify(Curve), Length, Domain
intcrv_3 = Interpolate(Vertices=move.Geometry, Degree=3, Periodic=toggle, KnotStyle=1)  # -> simplify(Curve), Length, Domain
intcrv_4 = Interpolate(Vertices=move_2.Geometry, Degree=3, Periodic=toggle, KnotStyle=1)  # -> simplify(Curve), Length, Domain
loft = Loft(
    Curves=[intcrv_3.Curve, intcrv_4.Curve],
    Options={Adjust=False, Closed=False, LoftEnds=0, LoftSimp=0, LoftType=0, Rebuild=10, Refit=0.01})
loft_2 = Loft(
    Curves=[intcrv.Curve, intcrv_2.Curve],
    Options={Adjust=False, Closed=False, LoftEnds=0, LoftSimp=0, LoftType=0, Rebuild=10, Refit=0.01})
offsrf = OffsetSurface(Surface=loft_2, Distance=num_8, BothSides=True, CreateSolid=True)
offsrf_2 = OffsetSurface(Surface=loft, Distance=num_8, BothSides=True, CreateSolid=True)

number_slider_2 = Slider(0.03, range=0..0.1)

subtraction_3 = Subtraction(A=num_5, B=1)
subtraction_4 = Subtraction(A=num_7, B=1)
filter_7 = StreamFilter(Gate=bool_7, Stream0=subtraction_3, Stream1=num_5)
filter_8 = StreamFilter(Gate=bool_8, Stream0=subtraction_4, Stream1=num_7)
U_3 = Panel(filter_7)
V_3 = Panel(filter_8)
range_4 = Range(Domain=Domain(0, 1), Steps=filter_7)
range_5 = Range(Domain=Domain(0, 1), Steps=filter_8)
cull_i_3 = CullIndex(List=range_5, Indices=-1, Wrap=True)
cull_i_4 = CullIndex(List=range_4, Indices=-1, Wrap=True)
num_13 = Number(num_4)
addition_3 = Addition(A=cull_i_3, B=number_slider_2)
addition_4 = Addition(A=cull_i_4, B=number_slider_2)
filter_9 = StreamFilter(Gate=bool_8, Stream0=range_5, Stream1=addition_3)
filter_10 = StreamFilter(Gate=bool_7, Stream0=range_4, Stream1=addition_4)
pt_3 = ConstructPoint(XCoordinate=num_13, YCoordinate=graft(filter_9), ZCoordinate=0)
pt_4 = ConstructPoint(XCoordinate=graft(filter_10), YCoordinate=num_13, ZCoordinate=0)
evalsrf_3 = EvaluateSurface(Surface=reparameterize(srf_2), Point=pt_4)  # -> Point, Normal, UDirection, VDirection, Frame
evalsrf_4 = EvaluateSurface(Surface=reparameterize(srf_2), Point=pt_3)  # -> Point, Normal, UDirection, VDirection, Frame
amp_3 = Amplitude(Vector=evalsrf_4.VDirection, Amplitude=num_8)
amp_4 = Amplitude(Vector=evalsrf_3.UDirection, Amplitude=num_8)
neg_3 = Negative(Value=amp_3)
neg_4 = Negative(Value=amp_4)
toggle_2 = BooleanToggle(False)
move_5 = Move(Geometry=evalsrf_4.Point, Motion=amp_3)  # -> Geometry, Transform
move_6 = Move(Geometry=evalsrf_4.Point, Motion=neg_3)  # -> Geometry, Transform
move_7 = Move(Geometry=evalsrf_3.Point, Motion=neg_4)  # -> Geometry, Transform
move_8 = Move(Geometry=evalsrf_3.Point, Motion=amp_4)  # -> Geometry, Transform
intcrv_5 = Interpolate(Vertices=move_8.Geometry, Degree=3, Periodic=toggle_2, KnotStyle=1)  # -> simplify(Curve), Length, Domain
intcrv_6 = Interpolate(Vertices=move_5.Geometry, Degree=3, Periodic=toggle_2, KnotStyle=1)  # -> simplify(Curve), Length, Domain
intcrv_7 = Interpolate(Vertices=move_7.Geometry, Degree=3, Periodic=toggle_2, KnotStyle=1)  # -> simplify(Curve), Length, Domain
intcrv_8 = Interpolate(Vertices=move_6.Geometry, Degree=3, Periodic=toggle_2, KnotStyle=1)  # -> simplify(Curve), Length, Domain
seam = Seam(Curve=reparameterize(intcrv_8.Curve), Seam=number_slider_2)
seam_2 = Seam(Curve=reparameterize(intcrv_6.Curve), Seam=number_slider_2)
seam_3 = Seam(Curve=reparameterize(intcrv_7.Curve), Seam=number_slider_2)
seam_4 = Seam(Curve=reparameterize(intcrv_5.Curve), Seam=number_slider_2)
loft_3 = Loft(Curves=[seam, seam_2], Options={Adjust=False, Closed=False, LoftEnds=0, LoftSimp=0, LoftType=0, Rebuild=10, Refit=0.01})
loft_4 = Loft(
    Curves=[seam_4, seam_3],
    Options={Adjust=False, Closed=False, LoftEnds=0, LoftSimp=0, LoftType=0, Rebuild=10, Refit=0.01})
offsrf_3 = OffsetSurface(Surface=loft_3, Distance=num_6, BothSides=True, CreateSolid=True)
offsrf_4 = OffsetSurface(Surface=loft_4, Distance=num_6, BothSides=True, CreateSolid=True)

panel = Panel("""0
1""")
addition_5 = Addition(A=num_8, B=Slider(0.1, range=0..1))
pt_5 = ConstructPoint(XCoordinate=graft(panel), YCoordinate=num_9, ZCoordinate=0)
pt_6 = ConstructPoint(XCoordinate=num_9, YCoordinate=graft(panel), ZCoordinate=0)
evalsrf_5 = EvaluateSurface(Surface=reparameterize(srf_3), Point=pt_5)  # -> Point, Normal, UDirection, VDirection, Frame
evalsrf_6 = EvaluateSurface(Surface=reparameterize(srf_3), Point=pt_6)  # -> Point, Normal, UDirection, VDirection, Frame
neg_5 = Negative(Value=num_8)
neg_6 = Negative(Value=addition_5)
neg_7 = Negative(Value=addition_5)
neg_8 = Negative(Value=num_8)
amp_5 = Amplitude(Vector=evalsrf_5.UDirection, Amplitude=num_8)
amp_6 = Amplitude(Vector=evalsrf_5.UDirection, Amplitude=neg_5)
amp_7 = Amplitude(Vector=evalsrf_5.UDirection, Amplitude=addition_5)
amp_8 = Amplitude(Vector=evalsrf_5.UDirection, Amplitude=neg_6)
amp_9 = Amplitude(Vector=evalsrf_6.VDirection, Amplitude=num_8)
amp_10 = Amplitude(Vector=evalsrf_6.VDirection, Amplitude=addition_5)
amp_11 = Amplitude(Vector=evalsrf_6.VDirection, Amplitude=neg_8)
amp_12 = Amplitude(Vector=evalsrf_6.VDirection, Amplitude=neg_7)
multiplication = Multiplication(A=num_8, B=3)
move_9 = Move(Geometry=evalsrf_5.Point, Motion=amp_5)  # -> Geometry, Transform
move_10 = Move(Geometry=evalsrf_6.Point, Motion=amp_9)  # -> Geometry, Transform
move_11 = Move(Geometry=evalsrf_5.Point, Motion=amp_6)  # -> Geometry, Transform
move_12 = Move(Geometry=evalsrf_6.Point, Motion=amp_11)  # -> Geometry, Transform
move_13 = Move(Geometry=evalsrf_6.Point, Motion=amp_10)  # -> Geometry, Transform
move_14 = Move(Geometry=evalsrf_5.Point, Motion=amp_8)  # -> Geometry, Transform
move_15 = Move(Geometry=evalsrf_6.Point, Motion=amp_12)  # -> Geometry, Transform
move_16 = Move(Geometry=evalsrf_5.Point, Motion=amp_7)  # -> Geometry, Transform
intcrv_9 = Interpolate(Vertices=move_9.Geometry, Degree=3, Periodic=False, KnotStyle=1)  # -> Curve, Length, Domain
intcrv_10 = Interpolate(Vertices=move_10.Geometry, Degree=3, Periodic=False, KnotStyle=1)  # -> Curve, Length, Domain
intcrv_11 = Interpolate(Vertices=move_13.Geometry, Degree=3, Periodic=False, KnotStyle=1)  # -> Curve, Length, Domain
intcrv_12 = Interpolate(Vertices=move_12.Geometry, Degree=3, Periodic=False, KnotStyle=1)  # -> Curve, Length, Domain
intcrv_13 = Interpolate(Vertices=move_14.Geometry, Degree=3, Periodic=False, KnotStyle=1)  # -> Curve, Length, Domain
intcrv_14 = Interpolate(Vertices=move_11.Geometry, Degree=3, Periodic=False, KnotStyle=1)  # -> Curve, Length, Domain
intcrv_15 = Interpolate(Vertices=move_15.Geometry, Degree=3, Periodic=False, KnotStyle=1)  # -> Curve, Length, Domain
intcrv_16 = Interpolate(Vertices=move_16.Geometry, Degree=3, Periodic=False, KnotStyle=1)  # -> Curve, Length, Domain
ext = ExtendCurve(Curve=intcrv_9.Curve, Type=2, Start=num_8, End=num_8)
ext_2 = ExtendCurve(Curve=intcrv_16.Curve, Type=2, Start=multiplication, End=multiplication)
ext_3 = ExtendCurve(Curve=intcrv_14.Curve, Type=2, Start=num_8, End=num_8)
ext_4 = ExtendCurve(Curve=intcrv_10.Curve, Type=2, Start=num_8, End=num_8)
ext_5 = ExtendCurve(Curve=intcrv_13.Curve, Type=2, Start=multiplication, End=multiplication)
ext_6 = ExtendCurve(Curve=intcrv_12.Curve, Type=2, Start=num_8, End=num_8)
ext_7 = ExtendCurve(Curve=intcrv_15.Curve, Type=2, Start=multiplication, End=multiplication)
ext_8 = ExtendCurve(Curve=intcrv_11.Curve, Type=2, Start=multiplication, End=multiplication)
loft_5 = Loft(Curves=[ext_8, ext_7], Options={Adjust=False, Closed=False, LoftEnds=0, LoftSimp=0, LoftType=0, Rebuild=10, Refit=0.01})
loft_6 = Loft(Curves=[ext, ext_3], Options={Adjust=False, Closed=False, LoftEnds=0, LoftSimp=0, LoftType=0, Rebuild=10, Refit=0.01})
loft_7 = Loft(Curves=[ext_4, ext_6], Options={Adjust=False, Closed=False, LoftEnds=0, LoftSimp=0, LoftType=0, Rebuild=10, Refit=0.01})
loft_8 = Loft(Curves=[ext_2, ext_5], Options={Adjust=False, Closed=False, LoftEnds=0, LoftSimp=0, LoftType=0, Rebuild=10, Refit=0.01})
offsrf_5 = OffsetSurface(Surface=loft_5, Distance=multiplication, BothSides=True, CreateSolid=True)
offsrf_6 = OffsetSurface(Surface=loft_7, Distance=num_8, BothSides=True, CreateSolid=True)
offsrf_7 = OffsetSurface(Surface=loft_6, Distance=num_8, BothSides=True, CreateSolid=True)
offsrf_8 = OffsetSurface(Surface=loft_8, Distance=multiplication, BothSides=True, CreateSolid=True)

panel_2 = Panel("""0
1""")
panel_3 = Panel(number_slider_2)
filter_11 = StreamFilter(Gate=bool_7, Stream0=panel_2, Stream1=panel_3)
filter_12 = StreamFilter(Gate=bool_8, Stream0=panel_2, Stream1=panel_3)
addition_6 = Addition(A=num_8, B=Slider(0.1, range=0..1))
pt_7 = ConstructPoint(XCoordinate=graft(filter_11), YCoordinate=num_4, ZCoordinate=0)
pt_8 = ConstructPoint(XCoordinate=num_4, YCoordinate=graft(filter_12), ZCoordinate=0)
evalsrf_7 = EvaluateSurface(Surface=reparameterize(srf_2), Point=pt_7)  # -> Point, Normal, UDirection, VDirection, Frame
evalsrf_8 = EvaluateSurface(Surface=reparameterize(srf_2), Point=pt_8)  # -> Point, Normal, UDirection, VDirection, Frame
neg_9 = Negative(Value=num_6)
neg_10 = Negative(Value=addition_6)
neg_11 = Negative(Value=addition_6)
neg_12 = Negative(Value=num_6)
amp_13 = Amplitude(Vector=evalsrf_7.UDirection, Amplitude=num_6)
amp_14 = Amplitude(Vector=evalsrf_7.UDirection, Amplitude=neg_9)
amp_15 = Amplitude(Vector=evalsrf_7.UDirection, Amplitude=addition_6)
amp_16 = Amplitude(Vector=evalsrf_7.UDirection, Amplitude=neg_10)
amp_17 = Amplitude(Vector=evalsrf_8.VDirection, Amplitude=num_6)
amp_18 = Amplitude(Vector=evalsrf_8.VDirection, Amplitude=addition_6)
amp_19 = Amplitude(Vector=evalsrf_8.VDirection, Amplitude=neg_12)
amp_20 = Amplitude(Vector=evalsrf_8.VDirection, Amplitude=neg_11)
multiplication_2 = Multiplication(A=num_6, B=3)
move_17 = Move(Geometry=evalsrf_7.Point, Motion=amp_13)  # -> Geometry, Transform
move_18 = Move(Geometry=evalsrf_8.Point, Motion=amp_17)  # -> Geometry, Transform
move_19 = Move(Geometry=evalsrf_7.Point, Motion=amp_14)  # -> Geometry, Transform
move_20 = Move(Geometry=evalsrf_8.Point, Motion=amp_19)  # -> Geometry, Transform
move_21 = Move(Geometry=evalsrf_8.Point, Motion=amp_18)  # -> Geometry, Transform
move_22 = Move(Geometry=evalsrf_7.Point, Motion=amp_16)  # -> Geometry, Transform
move_23 = Move(Geometry=evalsrf_8.Point, Motion=amp_20)  # -> Geometry, Transform
move_24 = Move(Geometry=evalsrf_7.Point, Motion=amp_15)  # -> Geometry, Transform
intcrv_17 = Interpolate(Vertices=move_17.Geometry, Degree=3, Periodic=False, KnotStyle=1)  # -> Curve, Length, Domain
intcrv_18 = Interpolate(Vertices=move_18.Geometry, Degree=3, Periodic=False, KnotStyle=1)  # -> Curve, Length, Domain
intcrv_19 = Interpolate(Vertices=move_21.Geometry, Degree=3, Periodic=False, KnotStyle=1)  # -> Curve, Length, Domain
intcrv_20 = Interpolate(Vertices=move_20.Geometry, Degree=3, Periodic=False, KnotStyle=1)  # -> Curve, Length, Domain
intcrv_21 = Interpolate(Vertices=move_22.Geometry, Degree=3, Periodic=False, KnotStyle=1)  # -> Curve, Length, Domain
intcrv_22 = Interpolate(Vertices=move_19.Geometry, Degree=3, Periodic=False, KnotStyle=1)  # -> Curve, Length, Domain
intcrv_23 = Interpolate(Vertices=move_23.Geometry, Degree=3, Periodic=False, KnotStyle=1)  # -> Curve, Length, Domain
intcrv_24 = Interpolate(Vertices=move_24.Geometry, Degree=3, Periodic=False, KnotStyle=1)  # -> Curve, Length, Domain
ext_9 = ExtendCurve(Curve=intcrv_17.Curve, Type=2, Start=num_6, End=num_6)
ext_10 = ExtendCurve(Curve=intcrv_24.Curve, Type=2, Start=multiplication_2, End=multiplication_2)
ext_11 = ExtendCurve(Curve=intcrv_22.Curve, Type=2, Start=num_6, End=num_6)
ext_12 = ExtendCurve(Curve=intcrv_18.Curve, Type=2, Start=num_6, End=num_6)
ext_13 = ExtendCurve(Curve=intcrv_21.Curve, Type=2, Start=multiplication_2, End=multiplication_2)
ext_14 = ExtendCurve(Curve=intcrv_20.Curve, Type=2, Start=num_6, End=num_6)
ext_15 = ExtendCurve(Curve=intcrv_23.Curve, Type=2, Start=multiplication_2, End=multiplication_2)
ext_16 = ExtendCurve(Curve=intcrv_19.Curve, Type=2, Start=multiplication_2, End=multiplication_2)
loft_9 = Loft(
    Curves=[ext_16, ext_15],
    Options={Adjust=False, Closed=False, LoftEnds=0, LoftSimp=0, LoftType=0, Rebuild=10, Refit=0.01})
loft_10 = Loft(Curves=[ext_9, ext_11], Options={Adjust=False, Closed=False, LoftEnds=0, LoftSimp=0, LoftType=0, Rebuild=10, Refit=0.01})
loft_11 = Loft(
    Curves=[ext_12, ext_14],
    Options={Adjust=False, Closed=False, LoftEnds=0, LoftSimp=0, LoftType=0, Rebuild=10, Refit=0.01})
loft_12 = Loft(
    Curves=[ext_10, ext_13],
    Options={Adjust=False, Closed=False, LoftEnds=0, LoftSimp=0, LoftType=0, Rebuild=10, Refit=0.01})
offsrf_9 = OffsetSurface(Surface=loft_11, Distance=num_6, BothSides=True, CreateSolid=True)
offsrf_10 = OffsetSurface(Surface=loft_10, Distance=num_6, BothSides=True, CreateSolid=True)
offsrf_11 = OffsetSurface(Surface=loft_9, Distance=multiplication_2, BothSides=True, CreateSolid=True)
offsrf_12 = OffsetSurface(Surface=loft_12, Distance=multiplication_2, BothSides=True, CreateSolid=True)

frame_thickness_2 = Number(num_3)
num_14 = Number(frame_hole_radius)
division_2 = Division(A=num_14, B=2)
division_3 = Division(A="1.75", B=2)
multiplication_3 = Multiplication(A=frame_thickness_2, B=3)
intcrv_25 = Interpolate(Vertices=evalsrf_4.Point, Degree=3, Periodic=False, KnotStyle=1)  # -> Curve, Length, Domain
intcrv_26 = Interpolate(Vertices=evalsrf_3.Point, Degree=3, Periodic=False, KnotStyle=1)  # -> Curve, Length, Domain
num_15 = Number(division_2)
ext_17 = ExtendCurve(Curve=intcrv_26.Curve, Type=2, Start=frame_thickness_2, End=frame_thickness_2)  # -> flatten(Curve)
ext_18 = ExtendCurve(Curve=intcrv_25.Curve, Type=2, Start=multiplication_3, End=multiplication_3)  # -> flatten(Curve)
ext_19 = ExtendCurve(Curve=intcrv_25.Curve, Type=2, Start=frame_thickness_2, End=frame_thickness_2)  # -> flatten(Curve)
ext_20 = ExtendCurve(Curve=intcrv_26.Curve, Type=2, Start=multiplication_3, End=multiplication_3)  # -> flatten(Curve)
pipe = Pipe(Curve=ext_20, Radius=num_15, Caps=1)  # -> flatten(Pipe)
pipe_2 = Pipe(Curve=ext_17, Radius=division_3, Caps=1)
pipe_3 = Pipe(Curve=ext_19, Radius=division_3, Caps=1)
pipe_4 = Pipe(Curve=ext_18, Radius=num_15, Caps=1)  # -> flatten(Pipe)
panel_4 = Panel("""0
-1""")
cull_i_5 = CullIndex(List=pipe, Indices=panel_4, Wrap=True)
brep = Brep(pipe_2)
cull_i_6 = CullIndex(List=pipe_4, Indices=panel_4, Wrap=True)
filter_13 = StreamFilter(Gate=0, Stream0=cull_i_5)
filter_14 = StreamFilter(Gate=0, Stream0=cull_i_6)
brep_2 = Brep(pipe_3)

# ---- group: U Frame
brep_3 = Brep(offsrf)

# ---- group: V frame
brep_4 = Brep(offsrf_2)

# ---- group: U outermost (large)
brep_5 = Brep(offsrf_8)

# ---- group: U outermost
brep_6 = Brep(offsrf_7)

# ---- group: V outermost
brep_7 = Brep(offsrf_6)

# ---- group: V outermost (large)
brep_8 = Brep(offsrf_5)

# ---- group: U Frame
brep_9 = Brep(offsrf_4)

# ---- group: V frame
brep_10 = Brep(offsrf_3)

# ---- group: U outermost
brep_11 = Brep(offsrf_10)

# ---- group: U outermost (large)
brep_12 = Brep(offsrf_12)

# ---- group: V outermost
brep_13 = Brep(offsrf_9)

# ---- group: V outermost (large)
brep_14 = Brep(offsrf_11)

# ---- group: U filament
brep_15 = Brep(pipe_2)

# ---- group: U filament (hole)
brep_16 = Brep(pipe)

# ---- group: U no outermost
brep_17 = Brep(filter_13)

# ---- group: V Filament
brep_18 = Brep(pipe_3)

# ---- group: V Filament (hole)
brep_19 = Brep(pipe_4)

# ---- group: V no outermost
brep_20 = Brep(filter_14)

# ----
sdiff = SolidDifference(BrepsA=simplify(brep_3), BrepsB=flatten(brep_8))
sdiff_2 = SolidDifference(BrepsA=simplify(brep_4), BrepsB=flatten(brep_5))
sdiff_3 = SolidDifference(BrepsA=simplify(brep_10), BrepsB=flatten(brep_12))
sdiff_4 = SolidDifference(BrepsA=simplify(brep_9), BrepsB=flatten(brep_14))
brep_21 = Brep(brep_18)
brep_22 = Brep(brep_15)
sunion = SolidUnion(Breps=flatten([sdiff_4, brep_22]))
sunion_2 = SolidUnion(Breps=flatten([brep_21, sdiff_3]))
bool_11 = Boolean(bool_3)
data = Data(frame_direction)
bool_12 = Boolean(bool_3)
data_2 = Data(frame_direction)
bool_13 = Boolean(bool)

srf_4 = Surface(srf_2)
number_slider_3 = Slider(200, range=-1..200)
number_slider_4 = Slider(0.04, range=0..1)
range_6 = Range(Domain=Domain(0, 1), Steps=number_slider_3)
addition_7 = Addition(A=number_slider_4, B=Slider(0, range=0..0.1))
subtraction_5 = Subtraction(A=1, B=number_slider_4)
multiplication_4 = Multiplication(A=number_slider_3, B=num)
subtraction_6 = Subtraction(A=1, B=number_slider_4)
multiplication_5 = Multiplication(A=number_slider_3, B=num_2)
dom = ConstructDomain(DomainStart=addition_7, DomainEnd=subtraction_5)
cull_i_7 = CullIndex(List=range_6, Indices="-1", Wrap=True)
dom_2 = ConstructDomain(DomainStart=number_slider_4, DomainEnd=subtraction_6)
cull_i_8 = CullIndex(List=range_6, Indices="-1", Wrap=True)
item = ListItem(List=range_6, Index="-1", Wrap=True)
range_7 = Range(Domain=dom, Steps=multiplication_4)
dup = DuplicateData(Data=cull_i_7, Number=num, Order=True)
item_2 = ListItem(List=range_6, Index="-1", Wrap=True)
range_8 = Range(Domain=dom_2, Steps=multiplication_5)
dup_2 = DuplicateData(Data=cull_i_8, Number=num_2, Order=True)
merge = Merge(Data1=flatten(dup), Data2=flatten(item))
merge_2 = Merge(Data1=flatten(dup_2), Data2=flatten(item_2))
number_slider_5 = Slider(4.3, range=0..10)
number_slider_6 = Slider(0.7, range=0..1)
shift = ShiftList(List=range_8, Shift=Slider(24, range=0..100), Wrap=True)
pt_9 = ConstructPoint(XCoordinate=merge, YCoordinate=range_7, ZCoordinate=0)
pt_10 = ConstructPoint(XCoordinate=shift, YCoordinate=merge_2, ZCoordinate=0)
evalsrf_9 = EvaluateSurface(Surface=reparameterize(srf_4), Point=pt_9)  # -> Point, Normal, UDirection, VDirection, Frame
evalsrf_10 = EvaluateSurface(Surface=reparameterize(srf_4), Point=pt_10)  # -> Point, Normal, UDirection, VDirection, Frame
intcrv_27 = Interpolate(Vertices=evalsrf_9.Point, Degree=3, Periodic=False, KnotStyle=1)  # -> Curve, Length, Domain
intcrv_28 = Interpolate(Vertices=evalsrf_10.Point, Degree=3, Periodic=False, KnotStyle=1)  # -> Curve, Length, Domain
crv = Curve(intcrv_26.Curve)
crv_2 = Curve(intcrv_25.Curve)
crv_3 = Curve(reparameterize(simplify(intcrv_27.Curve)))
addition_8 = Addition(A=num_3, B=1)
crv_4 = Curve(reparameterize(simplify(intcrv_28.Curve)))
ccx = CurveCurve(CurveA=crv_2, CurveB=intcrv_28.Curve)  # -> Points, ParamsA, ParamsB
addition_9 = Addition(A=num_3, B=1)
neg_13 = Negative(Value=number_slider_6)
neg_14 = Negative(Value=addition_8)
crv_cp = CurveClosestPoint(Point=ccx.Points, Curve=reparameterize(simplify(crv_4)))  # -> Point, Parameter, Distance
neg_15 = Negative(Value=number_slider_6)
neg_16 = Negative(Value=addition_9)
brep_cp = BrepClosestPoint(Point=ccx.Points, Brep=srf_4)  # -> Point, Normal, Distance
dom_3 = ConstructDomain(DomainStart=neg_13, DomainEnd=number_slider_6)
dom_4 = ConstructDomain(DomainStart=neg_14, DomainEnd=addition_8)
dom_5 = ConstructDomain(DomainStart=neg_15, DomainEnd=number_slider_6)
dom_6 = ConstructDomain(DomainStart=neg_16, DomainEnd=addition_9)
number_slider_7 = Slider(-25, range=-30..10)
eval = EvaluateCurve(Curve=graft(crv_4), Parameter=crv_cp.Parameter)  # -> Point, Tangent, Angle
pframe = PerpFrame(Curve=crv_4, Parameter=crv_cp.Parameter)
amp_21 = Amplitude(Vector=brep_cp.Normal, Amplitude=number_slider_5)  # -> simplify(Vector)
padjust = AdjustPlane(Plane=pframe, Normal=simplify(brep_cp.Normal))
ext_21 = ExtendCurve(Curve=intcrv_27.Curve, Type=0, Start=number_slider_7, End=number_slider_7)
ccx_2 = CurveCurve(CurveA=crv, CurveB=ext_21)  # -> Points, ParamsA, ParamsB
brep_cp_2 = BrepClosestPoint(Point=ccx_2.Points, Brep=srf_4)  # -> Point, Normal, Distance
crv_cp_2 = CurveClosestPoint(Point=ccx_2.Points, Curve=reparameterize(simplify(crv_3)))  # -> Point, Parameter, Distance
eval_2 = EvaluateCurve(Curve=graft(crv_3), Parameter=crv_cp_2.Parameter)  # -> Point, Tangent, Angle
pframe_2 = PerpFrame(Curve=crv_3, Parameter=crv_cp_2.Parameter)
amp_22 = Amplitude(Vector=brep_cp_2.Normal, Amplitude=number_slider_5)  # -> simplify(Vector)
padjust_2 = AdjustPlane(Plane=pframe_2, Normal=simplify(brep_cp_2.Normal))
align = AlignPlane(Plane=padjust_2, Direction=eval_2.Tangent)  # -> Plane, Angle
neg_17 = Negative(Value=amp_22)
align_2 = AlignPlane(Plane=padjust, Direction=eval.Tangent)  # -> Plane, Angle
neg_18 = Negative(Value=amp_21)
rectangle = Rectangle(Plane=align.Plane, XSize=dom_4, YSize=dom_3, Radius=0)  # -> Rectangle, Length
filter_15 = StreamFilter(Gate=bool_4, Stream0=amp_22, Stream1=neg_17)
rectangle_2 = Rectangle(Plane=align_2.Plane, XSize=dom_6, YSize=dom_5, Radius=0)  # -> Rectangle, Length
filter_16 = StreamFilter(Gate=bool_4, Stream0=amp_21, Stream1=neg_18)
extr = Extrude(Base=rectangle.Rectangle, Direction=filter_15)
extr_2 = Extrude(Base=rectangle_2.Rectangle, Direction=filter_16)
pipe_5 = Pipe(Curve=ext_21, Radius=1, Caps=1)
cap = CapHoles(Brep=extr)  # -> flatten(Brep)
pipe_6 = Pipe(Curve=intcrv_28.Curve, Radius=1, Caps=1)
cap_2 = CapHoles(Brep=extr_2)  # -> flatten(Brep)

brep_23 = Brep(pipe_5)
brep_24 = Brep(cap)
brep_25 = Brep(pipe_6)
brep_26 = Brep(cap_2)
sunion_3 = SolidUnion(Breps=flatten([brep_25, brep_26]))
sunion_4 = SolidUnion(Breps=flatten([brep_23, brep_24]))
sdiff_5 = SolidDifference(BrepsA=simplify(sunion), BrepsB=flatten(sunion_4))
sdiff_6 = SolidDifference(BrepsA=simplify(sunion_2), BrepsB=flatten(sunion_3))
brep_27 = Brep(brep_23)

brep_28 = Brep(brep_18)
brep_29 = Brep(brep_15)
filter_17 = StreamFilter(Gate=data, Stream0=brep_28, Stream1=brep_29)  # -> flatten(Stream)
panel_5 = Panel("""0
-1""")
cull_i_9 = CullIndex(List=filter_17, Indices=panel_5, Wrap=True)
filter_18 = StreamFilter(Gate=bool_12, Stream0=cull_i_9, Stream1=brep_27)  # -> flatten(Stream)

num_16 = Number(filter_9)
num_17 = Number(filter_10)
pt_11 = ConstructPoint(XCoordinate=graft(num_17), YCoordinate=num_16, ZCoordinate=0)
pt_12 = ConstructPoint(XCoordinate=num_17, YCoordinate=graft(num_16), ZCoordinate=0)
evalsrf_11 = EvaluateSurface(Surface=reparameterize(srf_2), Point=pt_12)  # -> simplify(Point), Normal, UDirection, VDirection, Frame
evalsrf_12 = EvaluateSurface(Surface=reparameterize(srf_2), Point=pt_11)  # -> simplify(Point), Normal, UDirection, VDirection, Frame
frame_thickness_3 = Number(num_3)
addition_10 = Addition(A=frame_thickness_3, B=1)
flip = FlipMatrix(Data=evalsrf_11.Point)
flip_2 = FlipMatrix(Data=evalsrf_11.Normal)
flip_3 = FlipMatrix(Data=evalsrf_12.Normal)
flip_4 = FlipMatrix(Data=evalsrf_12.Point)
neg_19 = Negative(Value=addition_10)
neg_20 = Negative(Value=division)
crv_5 = Curve(reparameterize(simplify(intcrv_26.Curve)))
crv_6 = Curve(reparameterize(simplify(intcrv_25.Curve)))
dom_7 = ConstructDomain(DomainStart=neg_19, DomainEnd=addition_10)
dom_8 = ConstructDomain(DomainStart=neg_20, DomainEnd=division)
crv_cp_3 = CurveClosestPoint(Point=flip, Curve=reparameterize(simplify(crv_5)))  # -> Point, Parameter, Distance
crv_cp_4 = CurveClosestPoint(Point=flip_4, Curve=reparameterize(simplify(crv_6)))  # -> Point, Parameter, Distance
eval_3 = EvaluateCurve(Curve=graft(crv_5), Parameter=crv_cp_3.Parameter)  # -> Point, Tangent, Angle
pframe_3 = PerpFrame(Curve=crv_5, Parameter=crv_cp_3.Parameter)
eval_4 = EvaluateCurve(Curve=graft(crv_6), Parameter=crv_cp_4.Parameter)  # -> Point, Tangent, Angle
pframe_4 = PerpFrame(Curve=crv_6, Parameter=crv_cp_4.Parameter)
amp_23 = Amplitude(Vector=flip_2, Amplitude=number_slider_5)  # -> simplify(Vector)
padjust_3 = AdjustPlane(Plane=pframe_3, Normal=simplify(flip_2))
amp_24 = Amplitude(Vector=flip_3, Amplitude=number_slider_5)  # -> simplify(Vector)
padjust_4 = AdjustPlane(Plane=pframe_4, Normal=simplify(flip_3))
align_3 = AlignPlane(Plane=padjust_3, Direction=eval_3.Tangent)  # -> Plane, Angle
neg_21 = Negative(Value=amp_23)
align_4 = AlignPlane(Plane=padjust_4, Direction=eval_4.Tangent)  # -> Plane, Angle
bool_14 = Boolean(bool_5)
neg_22 = Negative(Value=amp_24)
rectangle_3 = Rectangle(Plane=align_3.Plane, XSize=dom_7, YSize=dom_8, Radius=0)  # -> Rectangle, Length
rectangle_4 = Rectangle(Plane=align_4.Plane, XSize=dom_7, YSize=dom_8, Radius=0)  # -> Rectangle, Length
filter_19 = StreamFilter(Gate=Toggle(True), Stream0=amp_23, Stream1=neg_21)
filter_20 = StreamFilter(Gate=bool_14, Stream0=amp_24, Stream1=neg_22)
extr_3 = Extrude(Base=rectangle_4.Rectangle, Direction=filter_20)  # -> simplify(Extrusion)
extr_4 = Extrude(Base=rectangle_3.Rectangle, Direction=filter_19)
group = Group(Objects=extr_4)
group_2 = Group(Objects=extr_3)
flip_5 = FlipMatrix(Data=extr_4)
flip_6 = FlipMatrix(Data=extr_3)
group_3 = Group(Objects=flip_5)  # -> flatten(Group)
panel_6 = Panel("""0
-1""")
group_4 = Group(Objects=flip_6)  # -> flatten(Group)
item_3 = ListItem(List=group_3, Index=panel_6, Wrap=True)
item_4 = ListItem(List=group_4, Index=panel_6, Wrap=True)
ungroup = Ungroup(Group=item_3)
ungroup_2 = Ungroup(Group=item_4)
cap_3 = CapHoles(Brep=ungroup)  # -> simplify(Brep)
cap_4 = CapHoles(Brep=ungroup_2)  # -> simplify(Brep)

pt_13 = Point(evalsrf_12.Point)
pt_14 = Point(evalsrf_11.Point)
intcrv_29 = Interpolate(Vertices=pt_13, Degree=3, Periodic=True, KnotStyle=1)  # -> flatten(Curve), Length, Domain
intcrv_30 = Interpolate(Vertices=pt_14, Degree=3, Periodic=True, KnotStyle=1)  # -> flatten(Curve), Length, Domain

brep_30 = Brep(cap_4)
brep_31 = Brep(cap_3)
sunion_5 = SolidUnion(Breps=flatten([brep_16, brep_31]))
sunion_6 = SolidUnion(Breps=flatten([brep_19, brep_30]))
sdiff_7 = SolidDifference(BrepsA=simplify(brep_11), BrepsB=flatten(sunion_6))
sdiff_8 = SolidDifference(BrepsA=simplify(brep_13), BrepsB=flatten(sunion_5))
filter_21 = StreamFilter(Gate=data, Stream0=sdiff_7, Stream1=sdiff_8)

num_18 = Number(filter_5)
num_19 = Number(filter_6)
pt_15 = ConstructPoint(XCoordinate=num_19, YCoordinate=graft(num_18), ZCoordinate=0)
pt_16 = ConstructPoint(XCoordinate=graft(num_19), YCoordinate=num_18, ZCoordinate=0)
evalsrf_13 = EvaluateSurface(Surface=reparameterize(srf_3), Point=pt_15)  # -> simplify(Point), Normal, UDirection, VDirection, Frame
evalsrf_14 = EvaluateSurface(Surface=reparameterize(srf_3), Point=pt_16)  # -> simplify(Point), Normal, UDirection, VDirection, Frame
frame_thickness_4 = Number(num_3)
addition_11 = Addition(A=frame_thickness_4, B=1)
flip_7 = FlipMatrix(Data=evalsrf_13.Point)
flip_8 = FlipMatrix(Data=evalsrf_13.Normal)
flip_9 = FlipMatrix(Data=evalsrf_14.Normal)
flip_10 = FlipMatrix(Data=evalsrf_14.Point)
neg_23 = Negative(Value=addition_11)
neg_24 = Negative(Value=division)
dom_9 = ConstructDomain(DomainStart=neg_23, DomainEnd=addition_11)
dom_10 = ConstructDomain(DomainStart=neg_24, DomainEnd=division)
amp_25 = Amplitude(Vector=flip_8, Amplitude=number_slider_5)  # -> simplify(Vector)
amp_26 = Amplitude(Vector=flip_9, Amplitude=number_slider_5)  # -> simplify(Vector)
bool_15 = Boolean(bool_6)
neg_25 = Negative(Value=amp_25)
neg_26 = Negative(Value=amp_26)
filter_22 = StreamFilter(Gate=bool_15, Stream0=amp_25, Stream1=neg_25)
filter_23 = StreamFilter(Gate=bool_15, Stream0=amp_26, Stream1=neg_26)
panel_7 = Panel("""0
-1""")

frame_thickness_5 = Number(num_3)
num_20 = Number(frame_hole_radius)
intcrv_31 = Interpolate(Vertices=evalsrf_2.Point, Degree=3, Periodic=False, KnotStyle=1)  # -> Curve, Length, Domain
intcrv_32 = Interpolate(Vertices=evalsrf.Point, Degree=3, Periodic=False, KnotStyle=1)  # -> Curve, Length, Domain
multiplication_6 = Multiplication(A=frame_thickness_5, B=3)
division_4 = Division(A="1.75", B=2)
division_5 = Division(A=num_20, B=2)
num_21 = Number(division_5)
ext_22 = ExtendCurve(Curve=intcrv_32.Curve, Type=2, Start=multiplication_6, End=multiplication_6)  # -> flatten(Curve)
ext_23 = ExtendCurve(Curve=intcrv_32.Curve, Type=2, Start=frame_thickness_5, End=frame_thickness_5)  # -> flatten(Curve)
ext_24 = ExtendCurve(Curve=intcrv_31.Curve, Type=2, Start=multiplication_6, End=multiplication_6)  # -> flatten(Curve)
ext_25 = ExtendCurve(Curve=intcrv_31.Curve, Type=2, Start=frame_thickness_5, End=frame_thickness_5)  # -> flatten(Curve)
panel_8 = Panel("""0
-1""")
pipe_7 = Pipe(Curve=ext_22, Radius=num_21, Caps=2)  # -> flatten(Pipe)
cull_i_10 = CullIndex(List=pipe_7, Indices=panel_8, Wrap=True)
pipe_8 = Pipe(Curve=ext_23, Radius=division_4, Caps=1)
filter_24 = StreamFilter(Gate=0, Stream0=cull_i_10)

crv_7 = Curve(reparameterize(simplify(intcrv_31.Curve)))
crv_8 = Curve(reparameterize(simplify(intcrv_32.Curve)))
crv_cp_5 = CurveClosestPoint(Point=flip_7, Curve=reparameterize(simplify(crv_7)))  # -> Point, Parameter, Distance
crv_cp_6 = CurveClosestPoint(Point=flip_10, Curve=reparameterize(simplify(crv_8)))  # -> Point, Parameter, Distance
eval_5 = EvaluateCurve(Curve=graft(crv_7), Parameter=crv_cp_5.Parameter)  # -> Point, Tangent, Angle
pframe_5 = PerpFrame(Curve=crv_7, Parameter=crv_cp_5.Parameter)
eval_6 = EvaluateCurve(Curve=graft(crv_8), Parameter=crv_cp_6.Parameter)  # -> Point, Tangent, Angle
pframe_6 = PerpFrame(Curve=crv_8, Parameter=crv_cp_6.Parameter)
padjust_5 = AdjustPlane(Plane=pframe_5, Normal=simplify(flip_8))
padjust_6 = AdjustPlane(Plane=pframe_6, Normal=simplify(flip_9))
align_5 = AlignPlane(Plane=padjust_5, Direction=eval_5.Tangent)  # -> Plane, Angle
align_6 = AlignPlane(Plane=padjust_6, Direction=eval_6.Tangent)  # -> Plane, Angle
rectangle_5 = Rectangle(Plane=align_5.Plane, XSize=dom_9, YSize=dom_10, Radius=0)  # -> Rectangle, Length
rectangle_6 = Rectangle(Plane=align_6.Plane, XSize=dom_9, YSize=dom_10, Radius=0)  # -> Rectangle, Length
extr_5 = Extrude(Base=rectangle_6.Rectangle, Direction=filter_23)  # -> simplify(Extrusion)
extr_6 = Extrude(Base=rectangle_5.Rectangle, Direction=filter_22)
group_5 = Group(Objects=extr_6)
group_6 = Group(Objects=extr_5)
flip_11 = FlipMatrix(Data=extr_6)
flip_12 = FlipMatrix(Data=extr_5)
cull_i_11 = CullIndex(List=flatten(group_6), Indices=panel_8, Wrap=True)
cull_i_12 = CullIndex(List=flatten(group_5), Indices=panel_8, Wrap=True)
group_7 = Group(Objects=flip_11)  # -> flatten(Group)
group_8 = Group(Objects=flip_12)  # -> flatten(Group)
ungroup_3 = Ungroup(Group=cull_i_12)
ungroup_4 = Ungroup(Group=cull_i_11)
item_5 = ListItem(List=group_7, Index=panel_7, Wrap=True)
item_6 = ListItem(List=group_8, Index=panel_7, Wrap=True)
cap_5 = CapHoles(Brep=ungroup_3)  # -> simplify(Brep)
ungroup_5 = Ungroup(Group=item_5)
cap_6 = CapHoles(Brep=ungroup_4)  # -> simplify(Brep)
ungroup_6 = Ungroup(Group=item_6)
cap_7 = CapHoles(Brep=ungroup_5)  # -> simplify(Brep)
cap_8 = CapHoles(Brep=ungroup_6)  # -> simplify(Brep)

dupln = RemoveDuplicateLines(Lines=ext_24, Tolerance=0.01)
dupln_2 = RemoveDuplicateLines(Lines=ext_25, Tolerance=0.01)

pipe_9 = Pipe(Curve=dupln, Radius=num_21, Caps=2)  # -> flatten(Pipe)
cull_i_13 = CullIndex(List=pipe_9, Indices=panel_8, Wrap=True)
filter_25 = StreamFilter(Gate=0, Stream0=cull_i_13)
pipe_10 = Pipe(Curve=dupln_2, Radius=division_4, Caps=1)

cull_i_14 = CullIndex(List=flatten(group_2), Indices=panel_8, Wrap=True)
cull_i_15 = CullIndex(List=flatten(group), Indices=panel_8, Wrap=True)
ungroup_7 = Ungroup(Group=cull_i_15)
ungroup_8 = Ungroup(Group=cull_i_14)
cap_9 = CapHoles(Brep=ungroup_7)  # -> simplify(Brep)
cap_10 = CapHoles(Brep=ungroup_8)  # -> simplify(Brep)

# ---- group: U no outermost
brep_32 = Brep(filter_25)

# ---- group: V Filament
brep_33 = Brep(pipe_8)

# ---- group: V no outermost
brep_34 = Brep(filter_24)

# ----
brep_35 = Brep(cap_6)
brep_36 = Brep(cap_8)
brep_37 = Brep(cap_5)
brep_38 = Brep(cap_7)

# ---- group: U filament
brep_39 = Brep(pipe_10)

# ---- group: V Filament (hole)
brep_40 = Brep(pipe_7)

# ---- group: U filament (hole)
brep_41 = Brep(pipe_9)

# ----
brep_42 = Brep(cap_10)
brep_43 = Brep(cap_9)
panel_9 = Panel(brep_38)
sdiff_9 = SolidDifference(BrepsA=simplify(brep_7), BrepsB=flatten(brep_38))
sunion_7 = SolidUnion(Breps=flatten([brep_38, brep_41]))
sunion_8 = SolidUnion(Breps=flatten([brep_40, brep_36]))
sdiff_10 = SolidDifference(BrepsA=simplify(brep_6), BrepsB=flatten(sunion_8))
sunion_9 = SolidUnion(Breps=flatten(sdiff_9))
sdiff_11 = SolidDifference(BrepsA=simplify(flatten(sunion_9)), BrepsB=flatten(brep_41))
sdiff_12 = SolidDifference(BrepsA=simplify(flatten(brep_7)), BrepsB=flatten(brep_41))
brep_44 = Brep(brep_39)
brep_45 = Brep(brep_33)
sunion_10 = SolidUnion(Breps=flatten([brep_45, sdiff_2]))
sunion_11 = SolidUnion(Breps=flatten([brep_32, brep_37]))
sunion_12 = SolidUnion(Breps=flatten([sdiff, brep_44]))
brep_46 = Brep(brep_35)
sunion_13 = SolidUnion(Breps=[brep_42, brep_20])  # -> flatten(Result)
sdiff_13 = SolidDifference(BrepsA=simplify(sunion_12), BrepsB=flatten(brep_46))
brep_47 = Brep(brep_34)
sdiff_14 = SolidDifference(BrepsA=simplify(sunion_10), BrepsB=flatten(sunion_11))
sdiff_15 = SolidDifference(BrepsA=simplify(sdiff_13), BrepsB=flatten(brep_47))
sdiff_16 = SolidDifference(BrepsA=simplify(sunion), BrepsB=flatten(sunion_13))  # disabled
filter_26 = StreamFilter(Gate=bool_11, Stream0=sdiff_16, Stream1=sdiff_5)  # -> flatten(Stream)
filter_27 = StreamFilter(Gate=data, Stream0=sdiff_6, Stream1=filter_26)  # -> flatten(Stream)
filter_28 = StreamFilter(Gate=data_2, Stream0=dupln_2, Stream1=ext_23)  # -> flatten(Stream)
filter_29 = StreamFilter(Gate=bool_13, Stream0=filter_28, Stream1=intcrv_27.Curve)

brep_48 = Brep(brep_33)
brep_49 = Brep(brep_39)
filter_30 = StreamFilter(Gate=data, Stream0=brep_49, Stream1=brep_48)  # -> flatten(Stream)
cull_i_16 = CullIndex(List=filter_30, Indices="0", Wrap=True)
filter_31 = StreamFilter(Gate=bool_13, Stream0=cull_i_16, Stream1=filter_18)  # -> flatten(Stream)
preview = CustomPreview(Geometry=filter_31, Material=ColourSwatch(SwatchColor=RGB(255, 255, 255)))

len = Length(Curve=filter_29)
ma = MassAddition(Input=len)  # -> Result, PartialResults
wiring_length_mm = Panel(ma.Result)

filter_32 = StreamFilter(Gate=data, Stream0=sdiff_14, Stream1=sdiff_15)  # -> flatten(Stream)
filter_33 = StreamFilter(Gate=bool_13, Stream0=filter_32, Stream1=filter_27)  # -> flatten(Stream)
preview_2 = CustomPreview(Geometry=filter_33, Material=ColourSwatch(SwatchColor=RGB(138, 117, 255)))

filter_34 = StreamFilter(Gate=data, Stream0=sdiff_10, Stream1=sdiff_11)
filter_35 = StreamFilter(Gate=bool_13, Stream0=filter_34, Stream1=filter_21)  # -> flatten(Stream)
preview_3 = CustomPreview(Geometry=filter_35, Material=ColourSwatch(SwatchColor=RGB(202, 189, 54)))
